# Grasshopper definition Add 2 Numbers.ghx (Grasshopper 1.0.7)

A = GetInteger(AtLeast=1, AtMost=2147483647, Maximum=2147483647, Minimum=-2147483648, Prompt="First Integer")
B = GetInteger(AtLeast=1, AtMost=2147483647, Maximum=2147483647, Minimum=-2147483648, Prompt="2nd Integer")
addition = Addition(A=A, B=B)

# ---- group: RH_OUT:Total
number = Number(addition)
